# Dynamo graph Выбрать ряд импостов.dyn (Dynamo 2.3.0.5885)

file_path = Filename(".\getAllMullionsInLine.py")
file_from_path = FileObject(path=file_path)
readText = FileSystem.ReadText(file=file_from_path)
python_script_from_string = PythonStringNode(script=readText)  # unwired: IN[0]
