# Dynamo graph Обозачение дверей и проемов.dyn (Dynamo 2.3.0.5885)

file_path = Filename(".\generateDoorsNames.py")
file_from_path = FileObject(path=file_path)
readText = FileSystem.ReadText(file=file_from_path)
python_script_from_string = PythonStringNode(script=readText)
type = Object.Type()  # unwired: obj
