# Dynamo graph Из_параметра_типа_в_параметр_типа.dyn "Из параметра типа в параметр типа" (Dynamo 2.0.2.6826)

categories = Categories(index=512)  # graph input
all_elements_of_category = ElementsOfCategory(Category=categories)
code_block = CodeBlock { "Тип"; }
getParameterValueByName = Element.GetParameterValueByName(element=all_elements_of_category, parameterName=code_block)
type_из = StringInput("Описание")  # graph input
getParameterValueByName_2 = Element.GetParameterValueByName(element=getParameterValueByName, parameterName=type_из)
code_block_2 = CodeBlock(l=getParameterValueByName_2) { l==""; }
filterByBoolMask = List.FilterByBoolMask(list=getParameterValueByName, mask=code_block_2)
type_в = StringInput("t_Описание")  # graph input
getParameterValueByName_3 = Element.GetParameterValueByName(element=filterByBoolMask.out, parameterName=type_из)
setParameterByName = Element.SetParameterByName(element=filterByBoolMask.out, parameterName=type_в, value=getParameterValueByName_3)
formTabs = StringInput("По категории")  # graph input
