# Dynamo graph Из_параметра_типа_в_параметр_экземпляра.dyn "Из параметра типа в параметр экземпляра_upd" (Dynamo 2.3.0.5885)

categories = Categories("OST_CurtainWallPanels")  # graph input
all_elements_of_category = ElementsOfCategory(Category=categories)
sort = List.Sort(list=all_elements_of_category)
code_block = CodeBlock { "Тип"; }
getParameterValueByName = Element.GetParameterValueByName(element=sort, parameterName=code_block)
groupByKey = List.GroupByKey(list=sort, keys=getParameterValueByName)
groupByKey_2 = List.GroupByKey(list=getParameterValueByName, keys=getParameterValueByName)
firstItem = List.FirstItem()  # unwired: list
map = List.Map(list=groupByKey_2.groups, f_x=firstItem)
type_из = StringInput("Описание")  # graph input
getParameterValueByName_2 = Element.GetParameterValueByName(element=map, parameterName=type_из)
code_block_2 = CodeBlock(l=getParameterValueByName_2) { l==""; }
filterByBoolMask = List.FilterByBoolMask(list=groupByKey.groups, mask=code_block_2)
экземпляр_в = StringInput("Марка")  # graph input
filterByBoolMask_2 = List.FilterByBoolMask(list=getParameterValueByName_2, mask=code_block_2)
setParameterByName = Element.SetParameterByName(element=filterByBoolMask.out, parameterName=экземпляр_в, value=filterByBoolMask_2.out)
formTabs = StringInput("По категории")  # graph input
