# Dynamo graph Из_параметра_экземпляра_в_параметр_типа.dyn "Из параметра экземпляра в параметр типа_upd" (Dynamo 2.3.0.5885)

categories = Categories("OST_CurtainWallPanels")  # graph input
all_elements_of_category = ElementsOfCategory(Category=categories)
code_block = CodeBlock { "Тип"; }
getParameterValueByName = Element.GetParameterValueByName(element=all_elements_of_category, parameterName=code_block)
экземпляр_из = StringInput("Комментарии")  # graph input
getParameterValueByName_2 = Element.GetParameterValueByName(element=all_elements_of_category, parameterName=экземпляр_из)
code_block_2 = CodeBlock(l=getParameterValueByName_2) { l==""; }
filterByBoolMask = List.FilterByBoolMask(list=getParameterValueByName, mask=code_block_2)
type_в = StringInput("Комментарии к типоразмеру")  # graph input
filterByBoolMask_2 = List.FilterByBoolMask(list=all_elements_of_category, mask=code_block_2)
getParameterValueByName_3 = Element.GetParameterValueByName(element=filterByBoolMask_2.out, parameterName=экземпляр_из)
setParameterByName = Element.SetParameterByName(element=filterByBoolMask.out, parameterName=type_в, value=getParameterValueByName_3)
