# Dynamo graph Из_параметра_экземпляра_в_параметр_экземпляра.dyn (Dynamo 2.3.0.5885)

categories = Categories("OST_DuctCurves")  # graph input
all_elements_of_category = ElementsOfCategory(Category=categories)
экземпляр_из = StringInput("Марка")  # graph input
getParameterValueByName = Element.GetParameterValueByName(element=all_elements_of_category, parameterName=экземпляр_из)
code_block = CodeBlock(l=getParameterValueByName) { l==""; }
filterByBoolMask = List.FilterByBoolMask(list=all_elements_of_category, mask=code_block)
экземпляр_в = StringInput("Комментарии")  # graph input
setParameterByName = Element.SetParameterByName(element=filterByBoolMask.out, parameterName=экземпляр_в, value=getParameterValueByName)
formTabs = StringInput("По категории")  # graph input
